# Grasshopper definition pattern2.gh (Grasshopper 1.0.4)

crv = Curve(<curve referenced from the Rhino model>)
drec = DeconstuctRectangle(Rectangle=crv)  # -> BasePlane, XInterval, YInterval
range = Range(Domain=drec.XInterval, Steps=Slider(20, range=0..100))
range_2 = Range(Domain=drec.YInterval, Steps=Slider(20, range=0..100))
crossref = CrossReference(ListA=range, ListB=range_2, CrossMode=1)  # -> ListA, ListB
pdecon = Deconstruct(Point=drec.BasePlane)  # -> XComponent, YComponent, ZComponent
addition = Addition(A=crossref.ListA, B=pdecon.XComponent)
addition_2 = Addition(A=crossref.ListB, B=pdecon.YComponent)
pt = ConstructPoint(XCoordinate=addition, YCoordinate=addition_2, ZCoordinate=0)
image = ImageSampler(
    pt,
    FilePath="/Users/bbalogh/Desktop/34b77cbd897436a69d28de790ab6fbe2.jpg",
    Filter="Value",
    Interpolate=False,
    Umax=40,
    Umin=0,
    Vmax=40,
    Vmin=0,
    Wrap=1)
circle = CircleCNR(Normal=Vector(0, 0, 1), Radius=1)
