# Grasshopper definition weather.gh (Grasshopper 0.9.75)

path = FilePath("C:\Users\bbalogh\Desktop\may_weather_2016.csv")
file = ReadFile(File=path, PerLineParse=True)
list = ValueList({"Date": 0, "Max Temp": 1, "Mean Temp": 2, "Min Temp": 3, "Max Dew Point": 4, "Mean Dew Point": 5, "Min Dew Point": 6, "Max Humidity": 7, "Mean Humidity": 8, "Min Humidity": 9, "Max Pressure": 10, "Mean Pressure": 11, "Min Pressure": 12, "Max Visibility": 13, "Mean Visibility": 14, "Min Visibility": 15, "Max Wind Speed": 16, "Mean Wind Speed": 17, "Max Gust Speed": 18, "Preciptiation": 19, "Cloud Cover": 20, "Events": 21, "Wind Direction": 22}, selected="Max Wind Speed")
flip = FlipMatrix(Data=file)
split = TextSplit(Text=flip, Separators=",")
item = ListItem(List=split, Index=list, Wrap=True)
panel = Panel(item)
